# Requirement set GearControl (R2021b)

## 1 [#1] Gear Control (Container)
Encompasing requirements which validate the landing gear control functionality

### 1.1 [#2] The landing gear controller shall recieve the enumerated gear position states of "up" and "down"

### 1.2 [#3] The landing gear controller shall return the enumerated pump state of "on" or "off